# Requirement set GearControl (R2021b)

## 1 [#1] Gear Control (Container)
Encompasing requirements which validate the landing gear control functionality

### 1.1 [#2] The landing gear controller shall recieve the desired gear state of "up" or "down"

### 1.2 [#3] The landing gear controller shall return the commanded gear state of "up" or "down"

### 1.3 [#6] The gear command "up" shall be disabled when WoW is latched OR altitude AGL is below 50 feet

### 1.4 [#7] The gear controller shall command gear "down" on startup

### 1.5 [#8] Gear selection shall be disabled for 5 seconds after startup
AltitudeAGL requires a stable sensor state for an accurate measurement. Five seconds is to allow for presure, GPS, and laser measurements to stabalize and return averaged readings before allowing the AlltitudeAGL gear lockout path.